# Dynamo graph 01 - B to T Naming.dyn (Dynamo 3.3.0.6316)

select_model_elements_from_b_to = DSModelElementsSelection()  # "Select Model Elements from B to T"; 8 picked in the model; graph input
getLocation = Element.GetLocation(element=select_model_elements_from_b_to)
Y = Point.Y(point=getLocation)
sortByKey = List.SortByKey(list=select_model_elements_from_b_to, keys=Y)
instance_parameter_to_update = StringInput("Panel Name")  # graph input
copy_paste_from_excel = StringInput("")  # graph input
string = StringInput("\n")
split = String.Split(string=copy_paste_from_excel, separator0=string)
setParameterByName = Element.SetParameterByName(element=sortByKey.sortedList, parameterName=instance_parameter_to_update, value=split)
