# Dynamo graph 01 - L to R Circuit Naming.dyn (Dynamo 3.3.0.6316)
# packages: MEPover 2024.9.25

select_model_elements_from_l_to = DSModelElementsSelection()  # "Select Model Elements from L to R"; 8 picked in the model; graph input
getLocation = Element.GetLocation(element=select_model_elements_from_l_to)
X = Point.X(point=getLocation)
sortByKey = List.SortByKey(list=select_model_elements_from_l_to, keys=X)
electricalCircuit = Custom[Element.ElectricalCircuit](element=sortByKey.sortedList)  # package MEPover; Returns the electrical circuit of the element
instance_parameter_to_update = StringInput("Load Name")  # graph input
copy_paste_from_excel = StringInput("")  # graph input
string = StringInput("\n")
split = String.Split(string=copy_paste_from_excel, separator0=string)
setParameterByName = Element.SetParameterByName(element=electricalCircuit, parameterName=instance_parameter_to_update, value=split)
