# Dynamo graph 02 - Find and Replace Text within Selected Elements.dyn (Dynamo 3.3.0.6316)

categories = Categories("OST_ElectricalEquipment")
all_elements_of_category = ElementsOfCategory(Category=categories)
select_model_elements = DSModelElementsSelection()  # 8 picked in the model; graph input
parameter = StringInput("Panel Name")  # graph input
getParameterValueByName = Element.GetParameterValueByName(element=select_model_elements, parameterName=parameter)
find = StringInput("GEN")  # graph input
replace = StringInput("DD-01-GEN")  # graph input
replace_2 = String.Replace(string=getParameterValueByName, searchFor=find, replaceWith=replace)
setParameterByName = Element.SetParameterByName(element=select_model_elements, parameterName=parameter, value=replace_2)
watch = Watch(setParameterByName)
string = StringInput("")
number = DoubleInput(0)
