# Dynamo graph 03 - Update Mech CB and Wire.dyn (Dynamo 3.3.0.6316)
# packages: MEPover 2024.9.25, Rhythm 2024.10.1

select_model_elements = DSModelElementsSelection()  # 25 picked in the model
electricalCircuit = Custom[Element.ElectricalCircuit](element=select_model_elements)  # package MEPover; Returns the electrical circuit of the element
string = StringInput("Rating")
string_2 = StringInput("CFG_CIRCUIT BREAKER")
getParameterValueByName = Element.GetParameterValueByName(element=select_model_elements, parameterName=string_2)
code_block = CodeBlock { 0; 3; }
substring = String.Substring(string=getParameterValueByName, startIndex=code_block.out0, length=code_block.out1)
toNumber = String.ToNumber(string=substring)
setParameterByName = Element.SetParameterByName(element=electricalCircuit, parameterName=string, value=toNumber)
string_3 = StringInput("CFG_WIRE TYPE")
string_4 = StringInput("CFG_POLES")
ʳʰʸᵗʰᵐ_elements = Rhythm.Revit.Elements.Elements.GetParameterValueByNameTypeOrInstance(element=select_model_elements, parameterName=string_4)
code_block_2 = CodeBlock(x=ʳʰʸᵗʰᵐ_elements, y=substring) { value = (x == 1 ? "2w"+y : x==2 ? "2w"+y : x == 3 ? "3w"+y : "FIX"); }
setParameterByName_2 = Element.SetParameterByName(element=electricalCircuit, parameterName=string_3, value=code_block_2)
