# Dynamo graph 03 - Update Mech Load Name based on 2 inputs.dyn (Dynamo 3.3.0.6316)
# packages: MEPover 2024.9.25

select_model_elements = DSModelElementsSelection()  # 344 picked in the model
electricalCircuit = Custom[Element.ElectricalCircuit](element=select_model_elements)  # package MEPover; Returns the electrical circuit of the element
string = StringInput("Load Name")
string_2 = StringInput("CFG_INSTANCE TYPE")
getParameterValueByName = Element.GetParameterValueByName(element=select_model_elements, parameterName=string_2)
string_3 = StringInput("CFG_MECH TAG NO")
getParameterValueByName_2 = Element.GetParameterValueByName(element=select_model_elements, parameterName=string_3)
code_block = CodeBlock(item0=getParameterValueByName, item1=getParameterValueByName_2) { item0 + "-" + item1; }
setParameterByName = Element.SetParameterByName(element=electricalCircuit, parameterName=string, value=code_block)
