# Dynamo graph 2 - Create all Room Tags.dyn (Dynamo 2.0.3.8810)

get_documents = Custom[Get Documents]()  # Queries all linked Revit files and retrieves their Name, LinkInstance and Document properties.

# group: STEP 2 - Set ARCH Link #
# note: Set to the Architects Link #
code_block = CodeBlock { 0; }

# group: Script Settings
# note: "MSA-G-Room Tag: Room Tag"
categories = Categories(index=425)
family_types = FamilyTypes(index=0)
# note: Set to "ViewPlan"
# note: Set to "Rooms"
element_types = ElementTypes(index=334)

# group: Magic Time - Add all tags per room on all view plans and move them to room locations
getItemAtIndex = List.GetItemAtIndex(list=get_documents.Link_Instance, index=code_block)
get_all_elements_from_linked = Custom[Get All Elements From Linked Model](LinkDoc=getItemAtIndex, Category=categories)  # This node is based on code posted by Julien Benoit. Big thanks to Julien for sharing his work. This node will retrieve all elements of a given category from a given linked model.
create_annotation_tag_multi = Custom[Create Annotation Tag (Multi-Category)]()  # frozen; unwired: TagLocations, TagType, Elements, view
all_elements_of_type = ElementsOfType(element_type=element_types)
parentView = Rhythm.Revit.Views.View.ParentView(view=all_elements_of_type)
list_create = List.Create(item0=parentView)
code_block_2 = CodeBlock { "No parent"; }
boolean = BoolSelector(true)
# note: Ignore this is it errors
contains = String.Contains(str=list_create, searchFor=code_block_2, ignoreCase=boolean)
flatten = List.Flatten(list=contains)
boolean_2 = BoolSelector(false)
replaceNull = Custom[List.ReplaceNull](seq=flatten, replacement=boolean_2)  # Replaces all null values within a given list with a substitute
filterByBoolMask = List.FilterByBoolMask(list=all_elements_of_type, mask=replaceNull)
firstItem = List.FirstItem(list=filterByBoolMask.in@L1)
getItemAtIndex_2 = List.GetItemAtIndex(list=get_documents.Link_Name, index=code_block)
boolean_3 = BoolSelector(true)

# group: STEP 2 - Unfreeze this node and run again
# note: Freeze this node, then run to get the Link Node#
location = Custom[Element.Location+](element=get_all_elements_from_linked)  # Returns the location of an element as point, curve or curve loop, along with some booleans to help filtering the results. Unlike the OOTB Element.GetLocation node, it also retunrs sketch lines of sketch-based elements like floor slabs as well as the element's rotation property.

# group (continued): Magic Time - Add all tags per room on all view plans and move them to room locations
count = List.Count(list=location.points)
flatten_2 = List.Flatten(list=location.points)
filterByBoolMask_2 = List.FilterByBoolMask(list=get_all_elements_from_linked, mask=location.hasLocation)

code_block_3 = CodeBlock { use 292 for Millenial Project; }

# group: STEP 1 - Run and find ARCH Link#
# note: Architects Link# will display
# once this node runs----->>>
getDocuments = archilab.Revit.Selection.Select.GetDocuments()

create_annotation_tag_multi_2 = Custom[Create Annotation Tag (Multi-Category)](TagLocations=flatten_2, TagType=family_types, Elements=filterByBoolMask_2.in, Views=firstItem, LinkInstance=getItemAtIndex_2, RunIt=boolean_3)  # Note : This method is deprecated in Revit 2019. This node will create an annotation tag at a given location, of given type and in a supplied view. If only single view is supplied then all tags will be created in that view. Multi Category tag and Material Tag have been added to the original node. From archilab
