# Dynamo graph Bulk Pattern Electrical Circuiting - Copy.dyn "Bulk Pattern Electrical Circuiting" (Dynamo 2.16.2.5624)
# packages: MEPover 2024.9.25

select_model_elements = DSModelElementsSelection()  # 56 picked in the model
electricalCircuit = Custom[Element.ElectricalCircuit](element=select_model_elements)  # package MEPover; Returns the electrical circuit of the element
string = StringInput("Rating")
number = DoubleInput(60)
setParameterByName = Element.SetParameterByName(element=electricalCircuit, parameterName=string, value=number)
getParameterValueByName = Element.GetParameterValueByName()  # unwired: element, parameterName
string_2 = StringInput("FIND")
string_3 = StringInput("REPLACE")
replace = String.Replace(string=getParameterValueByName, searchFor=string_2, replaceWith=string_3)
string_4 = StringInput("text")
