# Dynamo graph CKT-NAME-CHANGING - Copy.dyn "CKT-NAME-CHANGING" (Dynamo 2.16.2.5624)

file_path = Filename("No file selected.")
file_from_path = FileObject(path=file_path)
string = StringInput("Load_Names")
boolean = BoolSelector(true)
importExcel = Data.ImportExcel(file=file_from_path, sheetName=string, readAsStrings=boolean, showExcel=boolean)
python_script = Python(IN[0]=importExcel)  # CPython3
# ---------- python_script.python (42 lines) ----------
# Load the Python Standard and DesignScript Libraries
import sys
import clr
clr.AddReference('RevitAPI')
clr.AddReference('RevitServices')
from RevitServices.Persistence import DocumentManager
from RevitServices.Transactions import TransactionManager
from Autodesk.Revit.DB import *

# The inputs to this node will be stored as a list in the IN variables
dataEnteringNode = IN

# Get the current Revit document
doc = DocumentManager.Instance.CurrentDBDocument

# Input from the Excel data
excel_data = IN[0]  # List of rows from the Excel sheet

# Start a transaction to make changes in the Revit model
TransactionManager.Instance.EnsureInTransaction(doc)

# Iterate through the Excel data (skipping header rows if necessary)
for row in excel_data[1:]:  # Start from the second row, assuming the first row is a header
    if len(row) < 2:
        continue  # Skip rows with insufficient data

    load_name, unique_id = row[0], row[1]

    # Get the element by UniqueId
    element = doc.GetElement(unique_id)
    if element:
        electrical_systems = element.MEPModel.GetElectricalSystems()
        for electrical_system in electrical_systems:
            # Update the Load Name
            if electrical_system and electrical_system.LoadName != load_name:
                electrical_system.LoadName = load_name

# End the transaction
TransactionManager.Instance.TransactionTaskDone()

# Output the result
OUT = "Load names updated successfully!"
# ----------------------------------------
