# Dynamo graph CKT-NAMING.dyn (Dynamo 2.16.2.5624)

python_script = Python()  # CPython3; unwired: IN[0]
# ---------- python_script.python (62 lines) ----------
# Load the Python Standard and DesignScript Libraries
import sys
import clr
clr.AddReference('RevitAPI')
clr.AddReference('RevitServices')
from RevitServices.Persistence import DocumentManager
from Autodesk.Revit.DB import *
from Autodesk.Revit.DB.Electrical import *
import System.Collections.Generic

# The inputs to this node will be stored as a list in the IN variables.
dataEnteringNode = IN

# Get the current Revit document
doc = DocumentManager.Instance.CurrentDBDocument

# Get all family instances of the specified types
element_types = ['EF_Duplex Receptacle_R2018']
elements = FilteredElementCollector(doc)\
    .OfClass(FamilyInstance)\
    .WhereElementIsNotElementType()\
    .ToElements()

# Initialize a dictionary to count load names
load_name_counts = {}

# First pass: count occurrences of each load name
for elem in elements:
    if elem.Symbol.Family.Name in element_types:
        electrical_systems = elem.MEPModel.GetElectricalSystems()
        for electrical_system in electrical_systems:
            load_name = electrical_system.LoadName if electrical_system.LoadName else "N/A"
            if load_name in load_name_counts:
                load_name_counts[load_name] += 1
            else:
                load_name_counts[load_name] = 1

# Second pass: filter out elements with duplicate load names
results = []
for elem in elements:
    if elem.Symbol.Family.Name in element_types:
        electrical_systems = elem.MEPModel.GetElectricalSystems()
        for electrical_system in electrical_systems:
            load_name = electrical_system.LoadName if electrical_system.LoadName else "N/A"
            if load_name_counts.get(load_name, 0) == 1:
                # Get the required parameters
                load_param = electrical_system.get_Parameter(BuiltInParameter.RBS_ELEC_APPARENT_LOAD)
                voltage_param = electrical_system.get_Parameter(BuiltInParameter.RBS_ELEC_VOLTAGE)

                apparent_load = load_param.AsValueString() if load_param and load_param.HasValue else "N/A"
                voltage = voltage_param.AsValueString() if voltage_param and voltage_param.HasValue else "N/A"
                
                rating = electrical_system.Rating if electrical_system.Rating else 0.0
                poles_number = electrical_system.PolesNumber if electrical_system.PolesNumber else 0
                panel_name = electrical_system.PanelName if electrical_system.PanelName else "N/A"
                unique_id = elem.UniqueId

                # Append the results with UniqueId included
                results.append((load_name, unique_id, apparent_load, voltage, poles_number, rating, panel_name))

# Assign your output to the OUT variable
OUT = results
# ----------------------------------------
file_path = Filename("No file selected.")
string = StringInput("Load_Names")
integer_slider = IntegerSlider(0, range=0..100 step 1)
code_block = CodeBlock { headers = [ ["Load Name", "Element ID", "kVA", "Voltage", "Phase", "Breaker Size", "Paneled By"] ]; }
python_script_2 = Python()  # CPython3; unwired: IN[0]
# ---------- python_script_2.python (59 lines) ----------
# Load the Python Standard and DesignScript Libraries
import sys
import clr
clr.AddReference('RevitAPI')
clr.AddReference('RevitServices')
from RevitServices.Persistence import DocumentManager
from Autodesk.Revit.DB import *
from Autodesk.Revit.DB.Electrical import *

# The inputs to this node will be stored as a list in the IN variables.
dataEnteringNode = IN

# Get the current Revit document
doc = DocumentManager.Instance.CurrentDBDocument

# Get all family instances of the specified types
element_types = ['EF_Duplex Receptacle_R2018']
elements = FilteredElementCollector(doc)\
    .OfClass(FamilyInstance)\
    .WhereElementIsNotElementType()\
    .ToElements()

# Initialize a dictionary to track seen load names
seen_load_names = {}

# Initialize results list
results = []

# Iterate through elements
for elem in elements:
    if elem.Symbol.Family.Name in element_types:
        electrical_systems = elem.MEPModel.GetElectricalSystems()
        for electrical_system in electrical_systems:
            load_name = electrical_system.LoadName if electrical_system.LoadName else "N/A"

            # Skip if load name already exists
            if load_name in seen_load_names:
                continue

            # Mark the load name as seen
            seen_load_names[load_name] = True
            
            # Get the required parameters
            load_param = electrical_system.get_Parameter(BuiltInParameter.RBS_ELEC_APPARENT_LOAD)
            voltage_param = electrical_system.get_Parameter(BuiltInParameter.RBS_ELEC_VOLTAGE)

            apparent_load = load_param.AsValueString() if load_param and load_param.HasValue else "N/A"
            voltage = voltage_param.AsValueString() if voltage_param and voltage_param.HasValue else "N/A"
            
            rating = electrical_system.Rating if electrical_system.Rating else 0.0
            poles_number = electrical_system.PolesNumber if electrical_system.PolesNumber else 0
            panel_name = electrical_system.PanelName if electrical_system.PanelName else "N/A"
            unique_id = elem.UniqueId  # Add UniqueId for tracking
            
            # Append to results
            results.append((load_name, unique_id, apparent_load, voltage, poles_number, rating, panel_name))

# Assign your output to the OUT variable
OUT = results
# ----------------------------------------
list_create = List.Create(item0=code_block, item1=python_script_2)
integer_slider_2 = IntegerSlider(1, range=0..100 step 1)
flatten = List.Flatten(list=list_create, amount=integer_slider_2)
boolean = BoolSelector(true)
exportToExcel = Data.ExportToExcel(filePath=file_path, sheetName=string, startRow=integer_slider, startColumn=integer_slider, data=flatten, overWrite=boolean)
