# Dynamo graph Circuit Find and Replace - Copy.dyn "Circuit Find and Replace" (Dynamo 2.16.2.5624)

categories = Categories("OST_ElectricalCircuit")
all_elements_of_category = ElementsOfCategory(Category=categories)
string = StringInput("Load Name")
getParameterValueByName = Element.GetParameterValueByName(element=all_elements_of_category, parameterName=string)
string_2 = StringInput("IDF-2.8")
string_3 = StringInput("IDF-2.7")
replace = String.Replace(string=getParameterValueByName, searchFor=string_2, replaceWith=string_3)
setParameterByName = Element.SetParameterByName(element=all_elements_of_category, parameterName=string, value=replace)
watch = Watch(setParameterByName)
