# Dynamo graph Delete Project Parameters - Copy.dyn (Dynamo 3.3.0.6316)
# packages: Clockwork for Dynamo 2.x 2.12.2

projectParameters = Custom[Document.ProjectParameters]()  # package Clockwork for Dynamo 2.x; Retrieves all project parameters and the categories they have been assigned to
name = Element.Name(element=projectParameters.parameterElement)
string = StringInput("Sheet")
contains = String.Contains(string=name, searchFor=string)
not_ = Not(x=contains)
string_2 = StringInput("View")
contains_2 = String.Contains(string=name, searchFor=string_2)
not_2 = Not(x=contains_2)
and_ = And(bool0=not_, bool1=not_2)
filterByBoolMask = List.FilterByBoolMask(list=projectParameters.parameterElement, mask=and_)
delete = Element.Delete(element=filterByBoolMask.in)
