# Dynamo graph Delete Project Parameters.dyn (Dynamo 3.3.0.6316)
# packages: Clockwork for Dynamo 2.x 2.12.2

projectParameters = Custom[Document.ProjectParameters]()  # package Clockwork for Dynamo 2.x; Retrieves all project parameters and the categories they have been assigned to
name = Element.Name(element=projectParameters.parameterElement)
string = StringInput("Sub-Discipline")
ne = name != string
filterByBoolMask = List.FilterByBoolMask(list=projectParameters.parameterElement, mask=ne)
delete = Element.Delete(element=filterByBoolMask.in)
