# Dynamo graph Delete Unused LineStyles.dyn (Dynamo 3.3.0.6316)

code_block = CodeBlock {  }
select_model_element = DSModelElementSelection()  # 1 picked in the model
python_script = Python(IN[0]=select_model_element)  # IronPython2
# ---------- python_script.python (58 lines) ----------
# Load the Python Standard and DesignScript Libraries
import sys
import clr
#import Autodesk
from System.Collections.Generic import *
clr.AddReference("RevitAPI")
clr.AddReference('ProtoGeometry')
clr.AddReference("RevitServices")
from RevitServices.Persistence import DocumentManager
import Autodesk
from Autodesk.DesignScript.Geometry import *
from Autodesk.Revit.DB import *
from Autodesk.Revit.DB.Structure import *
from Autodesk.Revit.DB.Architecture import *

doc = DocumentManager.Instance.CurrentDBDocument
uiapp = DocumentManager.Instance.CurrentUIApplication
app = uiapp.Application
uidoc=DocumentManager.Instance.CurrentUIApplication.ActiveUIDocument
revVersion = int(app.VersionNumber)
watch = []

dummyCrv = UnwrapElement(IN[0])

idIntsInUse = []
curves = FilteredElementCollector(doc).OfClass(CurveElement)
for crvElem in curves:
    styleId = crvElem.LineStyle.Id.IntegerValue
    idIntsInUse.append(styleId)
    
idIntsInUse = list(set(idIntsInUse))

styleIds = dummyCrv.GetLineStyleIds()

idsToDelete = List[ElementId]()
for sId in styleIds:
    style = doc.GetElement(sId)
    if style == None: continue
    if style.Name[0] == "<": continue
    
    if sId.IntegerValue in idIntsInUse: continue
    
    watch.append(style.Name)
    idsToDelete.Add(sId)
    
tr = Transaction(doc, "Purge unused line styles")
tr.Start()
doc.Delete(idsToDelete)
tr.Commit()
    

# The inputs to this node will be stored as a list in the IN variables.
#dataEnteringNode = IN

# Place your code below this line

# Assign your output to the OUT variable.
OUT = watch
# ----------------------------------------
watch = Watch(python_script)
