# Dynamo graph DistSystem.dyn (Dynamo 2.12.0.5650)

categories = Categories("OST_ElectricalEquipment")  # graph input
all_elements_of_category = ElementsOfCategory(Category=categories)
code_block = CodeBlock { "Dist System"; }
code_block_2 = CodeBlock { "Distribution System"; }
getParameterValueByName = Element.GetParameterValueByName(element=all_elements_of_category, parameterName=code_block_2)
name = Element.Name(element=getParameterValueByName)
setParameterByName = Element.SetParameterByName(element=all_elements_of_category, parameterName=code_block, value=name)
watch = Watch(all_elements_of_category)
