# Dynamo graph Dynamo Class Testing - Copy.dyn "Dynamo Class Testing" (Dynamo 3.3.0.6316)

select_model_elements = DSModelElementsSelection()  # 2 picked in the model
string = StringInput("Comments")
string_2 = StringInput("Mark")
getParameterValueByName = Element.GetParameterValueByName(element=select_model_elements, parameterName=string_2)
setParameterByName = Element.SetParameterByName(element=select_model_elements, parameterName=string, value=getParameterValueByName)
categories = Categories("OST_ElectricalEquipment")
all_elements_of_category = ElementsOfCategory(Category=categories)
id = Element.Id(element=all_elements_of_category)
string_3 = StringInput("Comments")
string_4 = StringInput("101-GEN-01-A")
setParameterByName_2 = Element.SetParameterByName(element=all_elements_of_category, parameterName=string_3, value=string_4)
type = Object.Type()  # unwired: object
python_script = Python()  # CPython3; unwired: IN[0]; starter script, not edited (OUT = 0)
