# Dynamo graph Electrical Element Filtering - Copy.dyn "Electrical Element Filtering" (Dynamo 2.16.2.5624)
# packages: MEPover 2024.9.25, Dynablaster 0.90.91

select_model_elements = DSModelElementsSelection()  # 217 picked in the model
string = StringInput("Apparent Load")
number = DoubleInput(144)
FIlterByParameterValue = Custom[Element.FIlterByParameterValue](elements=select_model_elements, parameterName=string, parameterValue=number)  # package Dynablaster; Filters the elements which parameter value equals the input value. Returns two lists, the first been "true" and the second "false"
electricalCircuit = Custom[Element.ElectricalCircuit](element=FIlterByParameterValue.in)  # package MEPover; Returns the electrical circuit of the element
string_2 = StringInput("Circuit Size")
string_3 = StringInput("2W20")
setParameterByName = Element.SetParameterByName(element=electricalCircuit, parameterName=string_2, value=string_3)
string_4 = StringInput("FIND")
string_5 = StringInput("REPLACE")
replace = String.Replace(searchFor=string_4, replaceWith=string_5)  # unwired: string
number_2 = DoubleInput(15)
string_6 = StringInput("Mark")
getParameterValueByName = Element.GetParameterValueByName(element=FIlterByParameterValue.in, parameterName=string_6)
watch = Watch(getParameterValueByName)
