# Dynamo graph Emergency Lighting Fixture Count - Copy.dyn "Emergency Lighting Fixture Count" (Dynamo 2.16.2.5624)

categories = Categories("OST_LightingFixtures")
all_elements_of_category = ElementsOfCategory(Category=categories)
string = StringInput("Emergency Fixture")
getParameterValueByName = Element.GetParameterValueByName(element=all_elements_of_category, parameterName=string)
code_block = CodeBlock { 1; }
eq = getParameterValueByName == code_block
filterByBoolMask = List.FilterByBoolMask(list=all_elements_of_category, mask=eq)
list_create = List.Create(item0=filterByBoolMask.in)
watch = Watch(list_create)
string_2 = StringInput("Comments")
string_3 = StringInput("Emergency")
setParameterByName = Element.SetParameterByName(element=filterByBoolMask.in, parameterName=string_2, value=string_3)
