# Dynamo graph Find and Replace Letter Within Circuit.dyn (Dynamo 2.16.2.5624)
# packages: MEPover 2024.9.25

select_model_elements = DSModelElementsSelection()  # 56 picked in the model
electricalCircuit = Custom[Element.ElectricalCircuit](element=select_model_elements)  # package MEPover; Returns the electrical circuit of the element
string = StringInput("Load Name")
getParameterValueByName = Element.GetParameterValueByName(element=electricalCircuit, parameterName=string)
string_2 = StringInput("-R-")
string_3 = StringInput("-M-")
replace = String.Replace(string=getParameterValueByName, searchFor=string_2, replaceWith=string_3)
setParameterByName = Element.SetParameterByName(element=electricalCircuit, parameterName=string, value=replace)
string_4 = StringInput("Rating")
string_5 = StringInput("text")
number = DoubleInput(60)
