# Dynamo graph FindandReplaceLetter - Copy.dyn "FindandReplaceLetter" (Dynamo 2.16.2.5624)

select_model_elements = DSModelElementsSelection()  # 840 picked in the model
string = StringInput("Comments")
getParameterValueByName = Element.GetParameterValueByName(element=select_model_elements, parameterName=string)
string_2 = StringInput("201")
string_3 = StringInput("201-MS-01-")
replace = String.Replace(string=getParameterValueByName, searchFor=string_2, replaceWith=string_3)
setParameterByName = Element.SetParameterByName(element=select_model_elements, parameterName=string, value=replace)
