# Dynamo graph FindandReplaceMarkText.dyn (Dynamo 2.16.2.5624)

select_model_elements = DSModelElementsSelection()  # 24 picked in the model
getLocation = Element.GetLocation(element=select_model_elements)
X = Point.X(point=getLocation)
sortByKey = List.SortByKey(list=select_model_elements, keys=X)
string = StringInput("Mark")
string_2 = StringInput("""202-PDU-01-A1
202-PDU-02-A1
202-PDU-04-A1
202-PDU-03-A1
202-PDU-01-B1
202-PDU-02-B1
202-PDU-04-B1
202-PDU-03-B1
202-PDU-01-C1
202-PDU-02-C1
202-PDU-04-C1
202-PDU-03-C1
202-PDU-01-D1
202-PDU-02-D1
202-PDU-04-D1
202-PDU-03-D1
202-PDU-01-E1
202-PDU-02-E1
202-PDU-04-E1
202-PDU-03-E1
202-PDU-01-F2
202-PDU-02-F2
202-PDU-04-F2
202-PDU-03-F2
""")
string_3 = StringInput("\n")
split = String.Split(string=string_2, separator0=string_3)
setParameterByName = Element.SetParameterByName(element=sortByKey.sortedList, parameterName=string, value=split)
