# Dynamo graph Mark Find and Replace - Copy.dyn "Mark Find and Replace" (Dynamo 2.16.2.5624)

categories = Categories("OST_ElectricalEquipment")
all_elements_of_category = ElementsOfCategory(Category=categories)
select_model_elements = DSModelElementsSelection()  # 7 picked in the model
string = StringInput("Mark")
getParameterValueByName = Element.GetParameterValueByName(element=select_model_elements, parameterName=string)
string_2 = StringInput("TGB")
string_3 = StringInput("EGB")
replace = String.Replace(string=getParameterValueByName, searchFor=string_2, replaceWith=string_3)
setParameterByName = Element.SetParameterByName(element=select_model_elements, parameterName=string, value=replace)
watch = Watch(setParameterByName)
