# Dynamo graph Name By X Coordinate Left to Right - Copy.dyn "Name By X Coordinate Left to Right" (Dynamo 3.3.0.6316)

select_model_elements = DSModelElementsSelection()  # 24 picked in the model
getLocation = Element.GetLocation(element=select_model_elements)
X = Point.X(point=getLocation)
sortByKey = List.SortByKey(list=select_model_elements, keys=X)
string = StringInput("Mark")
string_2 = StringInput("""GEN-101
GEN-102
GEN-103
GEN-104
GEN-105
GEN-106
GEN-107
GEN-108
GEN-201
GEN-202
GEN-203
GEN-204
GEN-205
GEN-206
GEN-207
GEN-208
GEN-301
GEN-302
GEN-303
GEN-304
GEN-305
GEN-306
GEN-307
GEN-308
""")
string_3 = StringInput("\n")
split = String.Split(string=string_2, separator0=string_3)
setParameterByName = Element.SetParameterByName(element=sortByKey.sortedList, parameterName=string, value=split)
