# Dynamo graph Name By X Coordinate Left to Right.dyn (Dynamo 2.16.2.5624)

select_model_elements = DSModelElementsSelection()  # 7 picked in the model
getLocation = Element.GetLocation(element=select_model_elements)
X = Point.X(point=getLocation)
sortByKey = List.SortByKey(list=select_model_elements, keys=X)
string = StringInput("Mark")
string_2 = StringInput("""EGB-E-172-2
EGB-E-173-2
EGB-E-174-2
EGB-E-175-2
EGB-E-176-2
EGB-E-177-2
EGB-E-178-2
""")
string_3 = StringInput("\n")
split = String.Split(string=string_2, separator0=string_3)
setParameterByName = Element.SetParameterByName(element=sortByKey.sortedList, parameterName=string, value=split)
