# Dynamo graph Panelboard name override.dyn (Dynamo 2.16.2.5624)

select_model_elements = DSModelElementsSelection()  # 24 picked in the model
string = StringInput("Panel Name")
string_2 = StringInput("Mark")
getParameterValueByName = Element.GetParameterValueByName(element=select_model_elements, parameterName=string_2)
setParameterByName = Element.SetParameterByName(element=select_model_elements, parameterName=string, value=getParameterValueByName)
