# Dynamo graph Remove Electrical Fixtures from Circuit.dyn (Dynamo 3.3.0.6316)

select_model_elements = DSModelElementsSelection()  # 48 picked in the model
watch = Watch(select_model_elements)
categories = Categories("OST_ElectricalCircuit")
all_elements_of_category = ElementsOfCategory(Category=categories)
python_script = Python(IN[0]=watch, IN[1]=all_elements_of_category)  # IronPython2
# ---------- python_script.python (40 lines) ----------
#Enable Python support and load DesignScript library
import clr
clr.AddReference('ProtoGeometry')
from Autodesk.DesignScript.Geometry import *

#import Revit Nodes
clr.AddReference('RevitNodes')
import Revit
clr.ImportExtensions(Revit.Elements)

#import RevitAPI
clr.AddReference('RevitAPI')
import Autodesk
from Autodesk.Revit.DB import *
from Autodesk.Revit.DB.Electrical import *

#import DocumentManager and TransactionManager
clr.AddReference('RevitServices')
from RevitServices.Persistence import DocumentManager
from RevitServices.Transactions import TransactionManager

#The inputs to this node will be stored as a list in the IN variables.
doc = DocumentManager.Instance.CurrentDBDocument
ElectricalComponents = UnwrapElement(IN[0])
ElectricalCircuits = UnwrapElement(IN[1])
ElecSet = ElementSet()

#Place your code below this line
for element in ElectricalComponents:
	ElecSet.Insert(element)

TransactionManager.Instance.EnsureInTransaction(doc)

for circuit in ElectricalCircuits:
	circuit.RemoveFromCircuit(ElecSet)

TransactionManager.Instance.TransactionTaskDone()

#Assign your output to the OUT variable.
OUT = ElectricalCircuits
# ----------------------------------------
