# Dynamo graph Rename Grids - Copy.dyn "Rename Grids" (Dynamo 2.16.2.5624)

categories = Categories("OST_Grids")
all_elements_of_category = ElementsOfCategory(Category=categories)
string = StringInput("Name")
getParameterValueByName = Element.GetParameterValueByName(element=all_elements_of_category, parameterName=string)
string_2 = StringInput("4.")
string_3 = StringInput("5.")
replace = String.Replace(string=getParameterValueByName, searchFor=string_2, replaceWith=string_3)
setParameterByName = Element.SetParameterByName(element=all_elements_of_category, parameterName=string, value=replace)
