# Dynamo graph Replace Sheet Number Prefix - Copy.dyn "Replace Sheet Number Prefix" (Dynamo 2.16.2.5624)

categories = Categories("OST_Sheets")
all_elements_of_category = ElementsOfCategory(Category=categories)
string = StringInput("Sheet Number")
sheetNumber = Sheet.SheetNumber(sheet=all_elements_of_category)
string_2 = StringInput("_4")
string_3 = StringInput("_5")
replace = String.Replace(string=sheetNumber, searchFor=string_2, replaceWith=string_3)
setParameterByName = Element.SetParameterByName(element=all_elements_of_category, parameterName=string, value=replace)
