# Dynamo graph Rotate.dyn (Dynamo 2.16.2.5624)

select_model_elements = DSModelElementsSelection()  # 49 picked in the model
code_block = CodeBlock { 180; }
setRotation = FamilyInstance.SetRotation(familyInstance=select_model_elements, degree=code_block)
