# Dynamo graph Schedule Renaming - Copy.dyn "Schedule Renaming" (Dynamo 2.16.2.5624)

string = StringInput("-R-")  # frozen
string_2 = StringInput("-M-")  # frozen
replace = String.Replace(searchFor=string, replaceWith=string_2)  # unwired: string
setParameterByName = Element.SetParameterByName(value=replace)  # unwired: element, parameterName
categories = Categories("OST_Schedules")
all_elements_of_category = ElementsOfCategory(Category=categories)
string_3 = StringInput("Panel Schedule Name")
getParameterValueByName = Element.GetParameterValueByName(element=all_elements_of_category, parameterName=string_3)
code_block = CodeBlock { ""; }
ne = getParameterValueByName != code_block
watch = Watch(ne)
