# Dynamo graph Sheet Testing - Copy.dyn "Sheet Testing" (Dynamo 3.3.0.6316)

categories = Categories("OST_Sheets")
all_elements_of_category = ElementsOfCategory(Category=categories)
string = StringInput("Sheet Number")
getParameterValueByName = Element.GetParameterValueByName(element=all_elements_of_category, parameterName=string)
string_2 = StringInput("E-90")
string_3 = StringInput("E-05")
replace = String.Replace(string=getParameterValueByName, searchFor=string_2, replaceWith=string_3)
setParameterByName = Element.SetParameterByName(element=all_elements_of_category, parameterName=string, value=replace)
