# Dynamo graph Sheet Testing.dyn (Dynamo 3.3.0.6316)

categories = Categories("OST_Sheets")
all_elements_of_category = ElementsOfCategory(Category=categories)
string = StringInput("Sheet Number")
getParameterValueByName = Element.GetParameterValueByName(element=all_elements_of_category, parameterName=string)
string_2 = StringInput(".1")
concat = String.Concat(string0=getParameterValueByName, string1=string_2)
setParameterByName = Element.SetParameterByName(element=all_elements_of_category, parameterName=string, value=concat)
