# Dynamo graph Testing Circuiting.dyn (Dynamo 3.3.0.6316)
# packages: MEPover 2024.9.25

select_panel = DSModelElementSelection()  # 1 picked in the model; graph input
select_fixtures = DSModelElementsSelection()  # 4 picked in the model; graph input
electricalCircuit = Custom[Element.ElectricalCircuit](element=select_fixtures)  # package MEPover; Returns the electrical circuit of the element
addToPanel = Custom[ElectricalSystem.AddToPanel](panel=select_panel, Circuits=electricalCircuit)  # package MEPover; Adds the circuits to the panel
string = StringInput("Load Name")
input_load_name = StringInput("OCC & ON")  # graph input
setParameterByName = Element.SetParameterByName(element=electricalCircuit, parameterName=string, value=input_load_name)
