# Dynamo graph X coordinate L to R for SLD.dyn (Dynamo 3.3.0.6316)

select_model_elements_from_l_to = DSModelElementsSelection()  # "Select Model Elements from L to R"; 8 picked in the model; graph input
getLocation = Element.GetLocation(element=select_model_elements_from_l_to)
X = Point.X(point=getLocation)
sortByKey = List.SortByKey(list=select_model_elements_from_l_to, keys=X)
instance_parameter_to_update = StringInput("Panel Name")  # graph input
copy_paste_from_excel = StringInput("""UPS-101
UPS-109
UPS-102
UPS-110
UPS-103
UPS-111
UPS-104
UPS-112
""")  # graph input
string = StringInput("\n")
split = String.Split(string=copy_paste_from_excel, separator0=string)
setParameterByName = Element.SetParameterByName(element=sortByKey.sortedList, parameterName=instance_parameter_to_update, value=split)
