# Dynamo graph mech testing.dyn (Dynamo 3.3.0.6316)
# packages: Rhythm 2024.10.1

views = Views()  # nothing selected; frozen
family_types = FamilyTypes("CFG_Electrical Connector - Testing:480V, 3 Phase, 3 Pole")
current = Document.Current()
getLinkInstances = Document.GetLinkInstances(document=current)
name = Element.Name(element=getLinkInstances)
string = StringInput("Mechanical")
contains = String.Contains(string=name, searchFor=string)
filterByBoolMask = List.FilterByBoolMask(list=getLinkInstances, mask=contains)
categories = Categories("OST_MechanicalEquipment")
allElementsOfCategory = LinkInstance.AllElementsOfCategory(linkInstance=filterByBoolMask.in, category=categories)
getLocation = LinkElement.GetLocation(linkedElement=allElementsOfCategory)
X = Point.X(point=getLocation)
Y = Point.Y(point=getLocation)
Z = Point.Z(point=getLocation)
byCoordinates = FamilyInstance.ByCoordinates(familyType=family_types, x=X, y=Y, z=Z)
string_2 = StringInput("Mark")
string_3 = StringInput("Equip")
ʳʰʸᵗʰᵐ_elements = Rhythm.Revit.Elements.Elements.GetParameterValueByNameTypeOrInstance(element=allElementsOfCategory, parameterName=string_3)
string_4 = StringInput("Num")
getParameterValueByName = Element.GetParameterValueByName(element=allElementsOfCategory, parameterName=string_4)
code_block = CodeBlock(item0=ʳʰʸᵗʰᵐ_elements, item1=getParameterValueByName) { item0+"-"+item1; }
setParameterByName = Element.SetParameterByName(element=byCoordinates, parameterName=string_2, value=code_block)
string_5 = StringInput("CFG_INSTANCE TYPE")
setParameterByName_2 = Element.SetParameterByName(element=byCoordinates, parameterName=string_5, value=ʳʰʸᵗʰᵐ_elements)
string_6 = StringInput("CFG_MECH TAG NO")
setParameterByName_3 = Element.SetParameterByName(element=byCoordinates, parameterName=string_6, value=getParameterValueByName)
