# Dynamo graph mech update testing.dyn "CTP02 Mech Updates" (Dynamo 3.3.0.6316)

select_model_elements = DSModelElementsSelection()  # 8 picked in the model; graph input
find = StringInput("RPP-1")  # graph input
replace = StringInput("RPP-2")  # graph input
replace_2 = String.Replace(searchFor=find, replaceWith=replace)  # unwired: string
setParameterByName = Element.SetParameterByName(element=select_model_elements, value=replace_2)  # unwired: parameterName
watch = Watch(setParameterByName)
string = StringInput("CRAH")
categories = Categories("OST_ElectricalEquipment")
all_elements_of_category = ElementsOfCategory(Category=categories)
string_2 = StringInput("MEP Schedule_HEX TAG NAME")
getParameterValueByName = Element.GetParameterValueByName(element=all_elements_of_category, parameterName=string_2)
eq = Equals(x=string, y=getParameterValueByName)
