# Dynamo graph wire addition testing.dyn (Dynamo 3.3.0.6316)

select_model_elements = DSModelElementsSelection()  # 4 picked in the model
views = Views("POWER - SEGMENTS MASTER")
python_script = Python(IN[0]=select_model_elements, IN[1]=views)  # CPython3
# ---------- python_script.python (77 lines) ----------
# Dynamo/Revit imports
import clr
clr.AddReference('RevitServices')
from RevitServices.Persistence import DocumentManager
from RevitServices.Transactions import TransactionManager

clr.AddReference('RevitAPI')
import Autodesk
from Autodesk.Revit.DB import FilteredElementCollector, BuiltInCategory, XYZ
from Autodesk.Revit.DB.Electrical import Wire, WireType, WiringType

# Current document
doc = DocumentManager.Instance.CurrentDBDocument

# Inputs from Dynamo
fixtures = UnwrapElement(IN[0])  # list of electrical fixtures
view = UnwrapElement(IN[1])      # view to draw wires in

# Get first available WireType
wire_types = FilteredElementCollector(doc)\
    .OfCategory(BuiltInCategory.OST_Wire)\
    .WhereElementIsElementType()\
    .ToElements()
wire_type = wire_types[0] if len(wire_types) > 0 else None

wire_length = 4.0  # feet offset from connector
wires_created = []

def get_first_connector(element):
    """Return the first electrical Connector object of an element, or None."""
    conns = None
    # For family instances
    if hasattr(element, "MEPModel") and element.MEPModel:
        cm = element.MEPModel.ConnectorManager
        if cm:
            conns = cm.Connectors
    # For other MEP elements
    elif hasattr(element, "ConnectorManager") and element.ConnectorManager:
        conns = element.ConnectorManager.Connectors

    if conns:
        for c in conns:
            return c
    return None

if wire_type is not None:
    TransactionManager.Instance.EnsureInTransaction(doc)

    for fixture in fixtures:
        start_connector = get_first_connector(fixture)

        if start_connector:
            start_pt = start_connector.Origin
            # Create an artificial end point 4ft in +Y direction
            end_pt = XYZ(start_pt.X, start_pt.Y + wire_length, start_pt.Z)

            vertices = [start_pt, end_pt]

            try:
                # Here startConnector is the actual connector on the fixture
                # endConnector is None (free end)
                wire = Wire.Create(doc,
                                   wire_type.Id,
                                   view.Id,
                                   WiringType.Arc,
                                   vertices,
                                   start_connector,
                                   None)
                wires_created.append(wire)
            except Exception as e:
                wires_created.append("Error: {}".format(e))
        else:
            wires_created.append("No connector found for element ID {}".format(fixture.Id))

    TransactionManager.Instance.TransactionTaskDone()

OUT = wires_created
# ----------------------------------------
